# Grasshopper definition basic test.gh (Grasshopper 1.0.8)
# plug-ins: Particle Engine

# Add Step-by-Step instructions on how to use the definition
panel = Panel("STEP 00")
number_slider = Slider(50, range=0..100)
center_box = CenterBox(Base=PlaneXY(0, 0, 0), X=number_slider, Y=number_slider, Z=number_slider)

# ----
# GH template
# rev2.1 2025.01
# Colour Key
# Notes
# PLP standard colours to group components according to their function
# Make a Group with the relevant name and Recompute canvas for automatic colouring
# Definition Name: xxxx
# Created By: xxxx
# Date Created: xxxx
# Date Last Modified: xxxx
# Version: xx
# Plugins Used: xxxx
# 
# 
# 
# Description
# xxxxx
panel_2 = Panel("Processing")
groupcolor = CSharpScript(Str="Input", Col=ColourSwatch(SwatchColor=RGB(184, 172, 242)))  # inputs Str: String, Col: Color
# ---------- groupcolor: C# usings ----------
using System.Drawing;
using Grasshopper.Kernel.Special;
# ---------- groupcolor: C# ----------
    GH_Document doc = owner.OnPingDocument();
    if (doc == null)
      return;

    foreach (var obj in doc.Objects)
    {
      GH_Group _group = obj as GH_Group;
      if( _group == null)
        continue;

      if(_group.NickName.Contains(Str))
      {
        _group.Colour = Col;
      }

    }
# ---------- end groupcolor ----------
groupcolor_2 = CSharpScript(Str="Parameters", Col=ColourSwatch(SwatchColor=RGB(86, 237, 245)))  # inputs Str: String, Col: Color; same code as groupcolor
groupcolor_3 = CSharpScript(Str=panel_2, Col=ColourSwatch(SwatchColor=RGB(245, 245, 245)))  # inputs Str: String, Col: Color; same code as groupcolor
groupcolor_4 = CSharpScript(Str="Output", Col=ColourSwatch(SwatchColor=RGB(83, 224, 161)))  # inputs Str: String, Col: Color; same code as groupcolor
groupcolor_5 = CSharpScript(Str="Run", Col=ColourSwatch(SwatchColor=RGB(224, 83, 83)))  # inputs Str: String, Col: Color; same code as groupcolor

box_spawn = BoxSpawn(Box=center_box, SpawnLocation=Slider(1, range=0..1), SpawnCount=Slider(50, range=0..100))
move_settings = MoveSettings(
    InitialSpeedVector=Slider(2, range=0..10),
    MaxSpeed=Slider(5, range=0..10),
    MaxForce=Slider(3, range=0..10),
    VelocityMultiplier=Slider(0.5, range=0..1))
flocking = Flocking(Connect=False, ViewAngle=180, SearchRadius=70, AlignValue=0.24, SeparationValue=0.09, CohesionValue=0.045)
trail_data = TrailData(Trail=Toggle(True), TrailStep="1", MaxTrailSize=Slider(500, range=0..1000))
number_slider_2 = Slider(100, range=0..100)
init_settings = InitSettings(SpawnSettings=box_spawn, Dimension=Slider(1, range=0..1), Boundary=Slider(0, range=0..100))
visual_settings = VisualSettings(TrailData=trail_data, ApplyTexture=False, DisplayMode=Slider(1, range=0..100))
controller = Controller(Behavior1=flocking)
trigger = Trigger(Interval=50, TimerInterval=50, Target=creeper_engine)  # disabled
boolean_toggle = BooleanToggle(True)
creeper_engine = Creeper_Engine(
    InitSettings=init_settings,
    MoveSettings=move_settings,
    BehavioralSettings=controller,
    VisualSettings=visual_settings,
    Reset=Button())  # -> Creepers, Trails, Connectivity
point = Point(creeper_engine.Creepers)
panel_3 = Panel(creeper_engine.Creepers)
nurbs_curve = NurbsCurve(Vertices=creeper_engine.Trails, Degree=3, Periodic=False)  # -> Curve, Length, Domain
panel_4 = Panel(creeper_engine.Trails)
